vi "Index.gviweb"   [LabVIEW NXG 5.0.0]
panel controls:
  "Load Measurement Data from Skynet": bool
  "Skylink": string = "https://siasky.net/CAAjYi5kLZYyA-PAKmo3SkBS78zGee4FeQAUUm2EO-javA"
panel indicators:
  "Data": f64[][]
  "Raw Data": string[][]
uses:
  App::Simlate_Delay.gviweb
  NI::HTTP::Open HTTP Handle.gvi
  NI::HTTP::GET.gvi
  App::ConvertData.gviweb
  NI::HTTP::Close HTTP Handle.gvi
diagram:
  while {
    event {
      on "Load Measurement Data from Skynet" Value changed {
        Set Busy(reference in=reference to unnamed front panel, error in=no error) -> (reference out=w1, error out=w2)
        call "Simlate_Delay.gviweb"(milliseconds to wait=3000, Error In=w2) -> (Error Out=w3)
        call "Open HTTP Handle.gvi"(error in=w3) -> (client handle out=w4, error out=w5)
        call "GET.gvi"(client handle=w4, url=$Skylink, error in=w5) -> (client handle out=w6, body=w7, error out=w8)
        call "ConvertData.gviweb"(RawData=w7, GraphRef=reference to "Data", Error In=w8) -> (All Channels=w9, Data=w10, Error Out=w11)
        $Data <- w9
        $"Raw Data" <- w10
        call "Close HTTP Handle.gvi"(client handle=w6, error in=w8)
        Unset Busy(reference in=w1, error in=w11)
      }
    }
    stop if FALSE
  }
